# Dynamo graph ssm_vop_v1.dyn (Dynamo 3.3.0.6316)
# packages: Clockwork for Dynamo 2.x 2.3.0

# note: IN[0] — Views
# List (or nested list) of Revit views to process.
# Only supported 2D orthographic/drafting views are used.
# Default: no default — user must supply.
# IN[1] — UseCache (bool)
# Controls whether the exporter reads/writes view-level cache.
# True → enable cache read/write (normal mode).
# False → disable cache entirely (no read, no write; every view recomputed).
# Default: True
# IN[2] — ForceRecompute (bool)
# Forces a full recompute for this run.
# True → ignore existing cache entries; recompute all views.
# Cache will not be written back at end of run.
# False → normal cache behavior.
# Default: False
# IN[3] — OutputFolderOverride (string)
# Optional folder path for saving CSVs, PNGs, and the cache file.
# If empty or null, the exporter uses the folder in the config: ~/Documents/_metrics
# Default: "" (no override)
# IN[4] — RenderPNG (bool)
# Enables or disables PNG occupancy rendering for the run.
# If provided, overrides CONFIG["occupancy_png"]["enabled"].
# True → generate PNGs
# False → skip PNG rendering
# Default: False
# IN[5] — CsvDateOverride (string)
# Override for the date token in CSV filenames.
# If empty or one of: auto, bydate, date → use today’s date.
# Otherwise the sanitized string becomes the date token.
# Example:
# 2024-12-31 → views_core_2024-12-31.csv
# RunA → views_vop_RunA.csv
# Default: "" (use today’s date)

current = Document.Current()
activeView = Document.ActiveView(document=current)
code_block = CodeBlock { 12345; 2; }
random_views = Python(IN[0]=code_block.out0, IN[1]=code_block.out1)  # CPython3
# ---------- random_views.python (102 lines) ----------
import clr
import random

# ------------------------------------------------------------
# Optional Dynamo inputs
# ------------------------------------------------------------
# IN[0] -> seed_value
# IN[1] -> n_per_type

try:
    seed_value = int(IN[0])
except:
    seed_value = 12345   # default seed

try:
    n_per_type = int(IN[1])
except:
    n_per_type = 2       # default count per view type

# ------------------------------------------------------------
# Resolve doc safely across RPS, pyRevit, Dynamo
# ------------------------------------------------------------
doc = None

# Try Dynamo first
try:
    clr.AddReference("RevitServices")
    from RevitServices.Persistence import DocumentManager
    doc = DocumentManager.Instance.CurrentDBDocument
except:
    pass

# Try RPS / pyRevit (__revit__)
if doc is None:
    try:
        doc = __revit__.ActiveUIDocument.Document
    except:
        pass

if doc is None:
    raise Exception("Could not resolve Revit document (doc).")

# ------------------------------------------------------------
# Revit API
# ------------------------------------------------------------
clr.AddReference("RevitAPI")
from Autodesk.Revit.DB import (
    FilteredElementCollector,
    View,
    ViewType
)

# ------------------------------------------------------------
# Supported views (matching v47 behavior)
# ------------------------------------------------------------
def get_supported_views(doc):
    all_views = FilteredElementCollector(doc).OfClass(View).ToElements()
    out = []
    for v in all_views:
        if v.IsTemplate:
            continue
        if v.ViewType in (
            ViewType.FloorPlan,
            ViewType.CeilingPlan,
            ViewType.AreaPlan,
            ViewType.EngineeringPlan,
            ViewType.Section,
            ViewType.Elevation,
            ViewType.Detail,
            ViewType.DraftingView,
            ViewType.Legend,
            ViewType.ThreeD,
        ):
            out.append(v)
    return out

# ------------------------------------------------------------
# Deterministic sample per-view-type
# ------------------------------------------------------------
def pick_random_views_per_type(doc, seed, n_per_type):
    random.seed(seed)

    views = get_supported_views(doc)

    # bucket by ViewType
    buckets = {}
    for v in views:
        buckets.setdefault(v.ViewType, []).append(v)

    result = []
    for bucket in buckets.values():
        if not bucket:
            continue
        k = min(n_per_type, len(bucket))
        result.extend(random.sample(bucket, k))

    return result

# ------------------------------------------------------------
# Output: LIST OF VIEWS ONLY
# ------------------------------------------------------------
OUT = pick_random_views_per_type(doc, seed_value, n_per_type)
# ----------------------------------------
useCache = BoolSelector(true)
forceRecompute = BoolSelector(false)
output_dir = Directory("C:\Users\gmcdowell\OneDrive - Stantec\Documents\KPSC")  # graph input
now = DateTime.Now()
string_from_object = FromObject(object=now)
code_block_2 = CodeBlock { "/"; ":"; " "; "PM"; ""; }
replace = String.Replace(string=string_from_object, searchFor=code_block_2.out0, replaceWith=code_block_2.out4)
replace_2 = String.Replace(string=replace, searchFor=code_block_2.out1, replaceWith=code_block_2.out4)
replace_3 = String.Replace(string=replace_2, searchFor=code_block_2.out2, replaceWith=code_block_2.out4)
replace_4 = String.Replace(string=replace_3, searchFor=code_block_2.out3, replaceWith=code_block_2.out4)
code_block_3 = CodeBlock(a=output_dir, b=replace_4) { a+"\\"+b; }
render_png = BoolSelector(true)
current_2 = Document.Current()
filePath = Document.FilePath(document=current_2)
length = String.Length(string=filePath)
code_block_4 = CodeBlock { 25; 10; }
code_block_5 = CodeBlock(x=length, y=code_block_4.out0) { x-y; }
date_override = String.Substring(string=filePath, startIndex=code_block_5, length=code_block_4.out1)
exporter_scaffold = Python(IN[0]=random_views, IN[1]=useCache, IN[2]=forceRecompute, IN[3]=code_block_3, IN[4]=render_png, IN[5]=date_override)  # CPython3
# ---------- exporter_scaffold.python (76 lines) ----------
"""
Dynamo thin loader for SSM_Exporter with module cache clearing.

This loader ensures code edits are picked up between runs without restarting Revit.
Place this in your Dynamo Python Script node.
"""
import sys
import os
import traceback
import importlib

sys.dont_write_bytecode = True

# MUST be the repo root that contains: core/, geometry/, export/, processing/, revit/
REPO_DIR = r"C:\Users\gmcdowell\Documents\Revit_SSM_Exporter"

# Basic validation to catch path mistakes
expected = [
    os.path.join(REPO_DIR, "ssm_exporter_main.py"),
    os.path.join(REPO_DIR, "core"),
    os.path.join(REPO_DIR, "geometry"),
    os.path.join(REPO_DIR, "export"),
    os.path.join(REPO_DIR, "processing"),
    os.path.join(REPO_DIR, "revit"),
]
missing = [p for p in expected if not os.path.exists(p)]
if missing:
    OUT = {
        "error": "REPO_DIR does not look like the SSM repo root (missing expected paths).",
        "REPO_DIR": REPO_DIR,
        "missing": missing,
    }
else:
    # Clean up sys.path: remove old repo paths that might conflict
    # But preserve Python stdlib paths (don't touch system Python paths)
    paths_to_remove = []
    for p in sys.path:
        if not p:
            continue
        # Remove old SSM or Fingerprint repo paths, but keep everything else
        if any(marker in p for marker in ["Revit_SSM_Exporter", "Revit_Fingerprint", "SSM_Exporter_Run"]):
            paths_to_remove.append(p)

    for p in paths_to_remove:
        while p in sys.path:
            sys.path.remove(p)

    # Insert this repo at the FRONT so it's found first, but keep stdlib paths intact
    sys.path.insert(0, REPO_DIR)

    try:
        # ---- CPython 3: purge cached modules so edits on disk are picked up ----
        # Only purge the repo's packages to avoid destabilizing stdlib / Dynamo internals.
        prefixes = ("core", "geometry", "export", "processing", "revit", "ssm_exporter_main")

        for name in list(sys.modules.keys()):
            if name in prefixes or name.startswith("core.") or name.startswith("geometry.") or name.startswith("export.") or name.startswith("processing.") or name.startswith("revit."):
                sys.modules.pop(name, None)

        # Import the main exporter module
        exporter = importlib.import_module("ssm_exporter_main")

        # Forward Dynamo inputs
        exporter.IN = IN

        # Execute and get output
        OUT = exporter._safe_main()

    except Exception as e:
        OUT = {
            "error": str(e),
            "traceback": traceback.format_exc(),
            "REPO_DIR": REPO_DIR,
            "sys_path_head": sys.path[:8],
            "exporter_file": getattr(sys.modules.get("ssm_exporter_main", None), "__file__", None),
        }
# ----------------------------------------
watch = Watch(exporter_scaffold)  # graph output
passthrough = Custom[Passthrough](passThrough=code_block_3, waitFor=exporter_scaffold)  # package Clockwork for Dynamo 2.x; Forces a sequential order of execution. The node wired into the output of the Passthrough node will be executed *after* the node wired into the waitFor input (e.g. important for some Revit operations). The value of the passThrough input will be passed on to the node wired into the output port of the Passthrough node.
code_block_6 = CodeBlock { "Baseline"; }
code_block_7 = CodeBlock(a=output_dir, b=code_block_6) { a+"\\"+b; }
python_script = Python(IN[0]=passthrough, IN[1]=code_block_7)  # CPython3
# ---------- python_script.python (224 lines) ----------
import csv
import hashlib
import os
from pathlib import Path

# -------------------------
# Inputs
# -------------------------
CURRENT_DIR = IN[0] if len(IN) > 0 else None
BASELINE_DIR = IN[1] if len(IN) > 1 else None

DROP_COLS = {"RunId", "ElapsedSec", "ConfigHash"}  # per your schema
PNG_SUBDIR = "occupancy"

# -------------------------
# Helpers
# -------------------------
def sha256_bytes(data):
    h = hashlib.sha256()
    h.update(data)
    return h.hexdigest()

def newest_match(dir_path, glob_pat):
    matches = list(dir_path.glob(glob_pat))
    if not matches:
        return None
    matches.sort(key=lambda p: p.stat().st_mtime, reverse=True)
    return matches[0]

def normalize_csv_bytes(path):
    with open(path, "r", encoding="utf-8-sig", newline="") as f:
        reader = csv.DictReader(f)
        if not reader.fieldnames:
            raise Exception("CSV has no header: {}".format(path))

        keep_cols = [c for c in reader.fieldnames if c not in DROP_COLS]

        rows = []
        for row in reader:
            rows.append({c: (row.get(c) or "") for c in keep_cols})

        # Hash-only stabilization
        sort_key = next((c for c in ("ViewId", "view_id", "viewid") if c in keep_cols), None)
        if sort_key:
            rows.sort(key=lambda r: r.get(sort_key, ""))

        lines = [",".join(keep_cols)]
        for r in rows:
            lines.append(",".join(r[c] for c in keep_cols))

        return ("\n".join(lines) + "\n").encode("utf-8")

def png_pixel_hash(path):
    import hashlib
    import clr

    clr.AddReference("System")
    clr.AddReference("System.Drawing")

    import System
    from System.Drawing import Bitmap, Rectangle
    from System.Drawing.Imaging import PixelFormat, ImageLockMode
    from System.Runtime.InteropServices import Marshal

    bmp = Bitmap(path)
    try:
        # Normalize to a stable pixel format (ARGB 32bpp)
        if bmp.PixelFormat != PixelFormat.Format32bppArgb:
            tmp = Bitmap(bmp)
            bmp.Dispose()
            bmp = tmp

        w, h = bmp.Width, bmp.Height
        rect = Rectangle(0, 0, w, h)

        data = bmp.LockBits(rect, ImageLockMode.ReadOnly, PixelFormat.Format32bppArgb)
        try:
            length = abs(data.Stride) * h
            buf = System.Array.CreateInstance(System.Byte, length)
            Marshal.Copy(data.Scan0, buf, 0, length)
            pixel_bytes = bytes(buf)
        finally:
            bmp.UnlockBits(data)

    finally:
        bmp.Dispose()

    payload = w.to_bytes(4, "little") + h.to_bytes(4, "little") + pixel_bytes
    hsh = hashlib.sha256()
    hsh.update(payload)
    return hsh.hexdigest()

def build_manifest_lines(run_dir):
    run_dir = Path(run_dir)
    lines = []

    vop_csv = newest_match(run_dir, "views_vop*.csv")
    core_csv = newest_match(run_dir, "views_core*.csv")

    occupancy_dir = run_dir / PNG_SUBDIR
    pngs = sorted(occupancy_dir.glob("*.png")) if occupancy_dir.is_dir() else []

    used = {
        "views_vop": str(vop_csv) if vop_csv else None,
        "views_core": str(core_csv) if core_csv else None,
        "png_dir": str(occupancy_dir) if occupancy_dir.exists() else None,
        "png_count": len(pngs),
    }

    if vop_csv:
        lines.append(
            "CSV  {}  {}".format(
                vop_csv.name,
                sha256_bytes(normalize_csv_bytes(str(vop_csv)))
            )
        )

    if core_csv:
        lines.append(
            "CSV  {}  {}".format(
                core_csv.name,
                sha256_bytes(normalize_csv_bytes(str(core_csv)))
            )
        )

    for p in pngs:
        lines.append(
            "PNG  {}  {}".format(
                p.name,
                png_pixel_hash(str(p))
            )
        )

    lines = sorted(lines)
    bundle_hash = sha256_bytes(("\n".join(lines) + "\n").encode("utf-8"))
    lines.append("BUNDLE  manifest  {}".format(bundle_hash))

    return "\n".join(lines) + "\n", bundle_hash, used

def parse_manifest(text):
    items = {}
    bundle = None
    for raw in (text or "").splitlines():
        line = raw.strip()
        if not line:
            continue
        parts = [p for p in line.split("  ") if p]
        if len(parts) < 3:
            continue
        typ, name, h = parts[0], parts[1], parts[2]
        items["{}::{}".format(typ, name)] = h
        if typ == "BUNDLE":
            bundle = h
    return items, bundle

# -------------------------
# Main
# -------------------------
if not CURRENT_DIR or not os.path.isdir(CURRENT_DIR):
    OUT = {
        "status": "ERROR",
        "error": "IN[0] must be a valid folder path",
        "received": CURRENT_DIR,
    }
else:
    cur_dir = Path(CURRENT_DIR)

    # Build current manifest
    cur_text, cur_bundle, used_files = build_manifest_lines(cur_dir)

    # Write current manifest
    cur_manifest_path = cur_dir / "manifest.sha256"
    cur_manifest_path.write_text(cur_text, encoding="utf-8")

    status = "NO_BASELINE"
    passed = None
    diff = {}
    base_bundle = None

    # Compare to baseline if provided
    if BASELINE_DIR and os.path.isdir(BASELINE_DIR):
        base_manifest_path = Path(BASELINE_DIR) / "manifest.sha256"
        if base_manifest_path.exists():
            base_text = base_manifest_path.read_text(encoding="utf-8")
            cur_items, _ = parse_manifest(cur_text)
            base_items, base_bundle = parse_manifest(base_text)

            passed = (cur_bundle == base_bundle)
            status = "PASS" if passed else "FAIL"

            if not passed:
                diff = {
                    "changed": [],
                    "missing_in_current": [],
                    "missing_in_baseline": [],
                }
                all_keys = sorted(set(cur_items.keys()) | set(base_items.keys()))
                for k in all_keys:
                    c = cur_items.get(k)
                    b = base_items.get(k)
                    if c is None:
                        diff["missing_in_current"].append(k)
                    elif b is None:
                        diff["missing_in_baseline"].append(k)
                    elif c != b:
                        diff["changed"].append(k)

    OUT = {
        "status": status,          # PASS / FAIL / NO_BASELINE / ERROR
        "pass": passed,
        "current": {
            "folder": str(cur_dir),
            "manifest": str(cur_manifest_path),
            "bundle_hash": cur_bundle,
            "used_files": used_files,
        },
        "baseline": {
            "folder": str(BASELINE_DIR) if BASELINE_DIR else None,
            "bundle_hash": base_bundle,
        },
        "diff": diff,
        "dropped_csv_columns": sorted(list(DROP_COLS)),
        "png_subdir": PNG_SUBDIR,
    }
# ----------------------------------------
watch_2 = Watch(python_script)
